# Grasshopper definition GHCitySim_solar.ghx (Grasshopper 1.0.7)

select_your_path = Panel("\Documents\GitHub\GHCitySim\simulation")
select_your_path_2 = Panel("\Documents\GitHub\GHCitySim\resources\CHE_Geneva.067000_IWEC.epw")
userdir = GhPythonScript()  # -> userdir
# ---------- userdir: Python ----------
import os
userdir = os.path.expanduser('~')
# ---------- end userdir ----------
userdir_2 = GhPythonScript()  # -> userdir; same code as userdir
join = TextJoin(Text=[userdir_2, select_your_path_2])
join_2 = TextJoin(Text=[userdir, select_your_path])

# ----
# 0. Set initial parameters...
# You can download CitySim solver from
# http://citysim.epfl.ch
# ... and let the bees and bugs fly
path_to_weather_file_epw = Panel(join)
honeybee = Honeybee_Honeybee()  # -> Vviiiiiiiiiizzz; plug-in component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
ladybug = Ladybug_Ladybug()  # -> Vviiiiiiiiiizzz; plug-in component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
# GH-CitySim: an interface to CitySim started by Giuseppe Peronato
# 
# © All rights reserved. Ecole polytechnique fédérale de Lausanne (EPFL), Switzerland,
# Laboratory of Integrated Performance in Design (LIPID), 2016-2018
# Developer: Giuseppe Peronato <giuseppe.peronato@alumni.epfl.ch>
# 
# Further development conducted at Uppsala University, Sweden.
# Division of Construction Engineering, 2019
# Developer: Giuseppe Peronato <giuseppe.peronato@angstrom.uu.se>
# 
# CitySim is a software developed and distributed by the
# Laboratory of Solar Energy and Building Physics (LESO-PB)
# http://citysim.epfl.ch/
# 
# Contributors:
# Aymeric Delmas <aymeric.delmas@imageen.re>
# 
# This tool relies on and will hopefully be part of
# Ladybug and Honeybee: two plugins for Environmental Analysis (GPL)
# started by Mostapha Sadeghipour Roudsari
simulation_directory = Panel(join_2)
path_to_citysim_solver = Panel("C:\CitySim.exe")
name_of_the_simulation = Panel("test-solar")
solver_path = Text(path_to_citysim_solver)
name = Text(name_of_the_simulation)
directory = FilePath(simulation_directory)
epw_path = FilePath(path_to_weather_file_epw)

# ----
# 1. Import Geometry
# You can use either closed or open breps
select_breps_to_simulate = Panel("""0
1
2
3""")
brep = Brep([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])
item = ListItem(List=brep, Index=select_breps_to_simulate, Wrap=True)
intersectmass = Honeybee_IntersectMasses(bldgMassesBefore=flatten(item))  # -> bldgMassesAfter; plug-in component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
panel = Panel(brep)
brep_2 = Brep(intersectmass)

meshresolution = Slider(4, range=0..10)
custom_mesh_settings = SettingsCustom(
    StitchSeams=False,
    SimplePlanes=False,
    Refine=True,
    MinCount=0,
    MaxCount=0,
    AspectRatio=20,
    MaxDistance=0,
    MaxAngle=20,
    MinEdge=meshresolution,
    MaxEdge=meshresolution)
mesh = MeshBrep(Brep=intersectmass, Settings=custom_mesh_settings)
faceb = FaceBoundaries(Mesh=mesh)
geometry = Curve(simplify(faceb))

# ----
# 1. Set Weather File
button = Button()
path = FilePath(directory)
epw_path_2 = FilePath(epw_path)
epw_to_cli = Honeybee_EpwToCli(epwFile=epw_path_2, dir=path, Run=button)  # -> out, CSobj; plug-in component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

obstruction_mesh = Mesh(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)

# ----
# 2. Define obstructions
horiziontal = Panel("""0
90
180
270
360""")
vertical = Panel("""10
10
10
10
10""")
terrain_mesh = Mesh(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)
name_2 = Text(name)
directory_2 = FilePath(directory)
directory_3 = FilePath(directory)
name_3 = Text(name)
false = Boolean(False)
directory_4 = FilePath(directory)
name_4 = Text(name)
citysim_srf = Honeybee_CitySimSrf(S=obstruction_mesh, R=Slider(0.2, range=0..1), dir=directory_2, name=name_2, Write=Button())  # -> out, CSobj; plug-in component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
citysim_srf_2 = Honeybee_CitySimSrf(S=terrain_mesh, R=Slider(0.1, range=0..1), type="terrain", Dup=false, dir=directory_3, name=name_3, Write=Button())  # -> out, CSobj; plug-in component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
citysim_horizon = Honeybee_CitySimHorizon(H=horiziontal, V=vertical, dir=directory_4, name=name_4, Write=Button())  # -> out, CSobj; plug-in component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

csobjs = Data([citysim_horizon.CSobj, citysim_srf_2.CSobj, citysim_srf.CSobj, epw_to_cli.CSobj])
geometry_2 = Curve(graft(geometry))
buildings_breps = Brep([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])
preview = CustomPreview(Geometry=terrain_mesh, Material=ColourSwatch(SwatchColor=RGB(153, 129, 129)))
preview_2 = CustomPreview(Geometry=obstruction_mesh, Material=ColourSwatch(SwatchColor=RGB(153, 153, 153)))

# ----
# 5. Load results
toggle = BooleanToggle(True)
directory_5 = FilePath(directory)
name_5 = Text(name)
citysim_loadsolar = Honeybee_CitySimLoadSolar(dir=directory_5, name=name_5, yearly=Toggle(False), geometry=geometry_2, Run=toggle)  # -> out, results; plug-in component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

not = GateNot(A=toggle)
python = GhPythonScript(Show=not, inGeom=buildings_breps)  # -> outGeom; inputs Show: Boolean, inGeom: GeometryBase
# ---------- python: Python ----------
"""Returns geometry depending on boolean status.
    Inputs:
        Show: Boolean
        inGeom: input geometry
    Output:
        a: output geometry"""

__author__ = "gperonato"
__version__ = "2019.02.25"

if Show:
    outGeom = inGeom
# ---------- end python ----------
preview_3 = CustomPreview(Geometry=python, Material=ColourSwatch(SwatchColor=RGB(168, 153, 153)))
geometry_3 = Curve(graft(geometry))

# ----
# 7. Create a solar radiation map
hourly_values = Data(citysim_loadsolar.results)
srf = Surface(geometry_3)
ma = MassAddition(Input=hourly_values)  # -> Result, PartialResults
division = Division(A=ma.Result, B=1000)
bnd = Bounds(Numbers=flatten(division))
dedomain = DeconstructDomain(Domain=bnd)  # -> Start, End
gradient = Gradient(
    LowerLimit=Slider(0, range=0..100),
    UpperLimit=dedomain.End,
    Parameter=division,
    stops=[0: RGB(0, 0, 255), 0.501: RGB(255, 255, 0), 0.854: RGB(255, 0, 0)])
preview_4 = CustomPreview(Geometry=srf, Shader=gradient)

# ----
# 4. Run simulation
geometry_4 = Curve(simplify(geometry))
solver = Text(solver_path)
directory_6 = FilePath(directory)
name_6 = Text(name)
csobjs_2 = Data(csobjs)

geometry_5 = Curve(simplify(geometry_4))
reflectance = Slider(0.2, range=0..1)
lng = ListLength(List=flatten(geometry_5))
dup = DuplicateData(Data=reflectance, Number=lng, Order=True)
unflatten = UnflattenTree(Tree=dup, Guide=geometry_5)
reflectance_2 = Text(unflatten)

citysim_solar = Honeybee_CitySimSolar(
    geometry=simplify(geometry_4),
    reflectance=reflectance_2,
    dir=directory_6,
    name=name_6,
    CSobjs=csobjs_2,
    Solver=solver,
    Write=Toggle(False),
    Run=Toggle(False))  # -> results; plug-in component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
